# Grasshopper definition 01_0_outdoor_airflow.gh (Grasshopper 1.0.7)
# plug-ins: Bifocals

# ----
# This file is set up in meters. If you're using a different units make sure to scale the input geometries.
# GEO
brep = Brep([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])

# ----
# step1 = 要測試的幾何
# BUTTERFLY GEOMETRIES
panel = Panel("GEO")
createbfgeometry = Butterfly_CreateButterflyGeometry(name=panel, geo=flatten(brep))  # -> report, BF_geo; plug-in component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

vec = VectorXYZ(XComponent=Slider(0.53, range=0..1), YComponent=Slider(1, range=0..1), ZComponent=0)  # -> Vector, Length
pt = ConstructPoint(XCoordinate=0, YCoordinate=0, ZCoordinate=0)
multiplication = Multiplication(A=vec.Vector, B=Slider(20, range=0..100))
windvector = Butterfly_WindVector(wind_speed="6", wind_direction=Point(0, 1, 0))  # -> wind_vector; plug-in component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
vdis = VectorDisplay(Anchor=pt, Vector=multiplication)

# ----
# step2 = 風場環境設定
panel_2 = Panel("FIELD")
# WIND TUNNEL
createcasefromtunnel = Butterfly_CreateCaseFromTunnel(
    name=panel_2,
    BF_geo=flatten(createbfgeometry.BF_geo),
    wind_vector=windvector,
    ref_wind_height=10,
    landscape=6,
    run=Toggle(False))  # -> report, block_pts, wind_tunnel, case; plug-in component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
# step3.1 = 設定分割格
panel_3 = Panel("2")
toggle = BooleanToggle(False)
# Grading
wtgrading = Butterfly_windTunnelGrading(wind_tunnel=createcasefromtunnel.wind_tunnel, cell_size=panel_3, cell_to_cell_ratio=1.2, wake_offset=2, height_offset=5)  # -> report, grad_xyz, cell_count_xyz, cell_count_tot, preview; plug-in component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
# PURGE CASE
purgecase = Butterfly_purgeCase(case=createcasefromtunnel.case, block_mesh=toggle, snappy_hex_mesh=toggle, results=toggle, post_processing=toggle)  # -> report; plug-in component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
# step5.2=設定測針區塊
number_slider = Slider(4, range=0..10)

# ----
# GROUND
brep_2 = Brep(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)

panel_4 = Panel(wtgrading.grad_xyz)
panel_5 = Panel(wtgrading.report)
panel_6 = Panel(createcasefromtunnel.report)
panel_7 = Panel(purgecase)
genpts = LBGeneratePointGrid(geometry=brep_2, grid_size=number_slider)  # -> points, vectors, face_areas, mesh; plug-in component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

# ----
# step3 = 分割風場
toggle_2 = BooleanToggle(False)

# ----
# MESHING
# BLOCKMESH
blockmesh = Butterfly_blockMesh(
    case=createcasefromtunnel.case,
    grad_xyz=wtgrading.grad_xyz,
    cell_count=wtgrading.cell_count_xyz,
    overwrite=True,
    write=toggle_2,
    run=Toggle(False))  # -> report, case; plug-in component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
# step5.1=設定計算參數
number_slider_2 = Slider(100, range=0..1000)

# ----
# step4 = 微氣候場域分割
toggle_3 = BooleanToggle(False)

# ----
# 測針分布
# 應用於 不可壓縮流的容積場
probes = Butterfly_probes(points=genpts.points, fields="U")  # -> probes; plug-in component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

# ----
# 計算時間
controldict = Butterfly_controlDict(start_time=0, end_time=number_slider_2, write_interval=100, write_compression=False, purge_write=0)  # -> control_dict; plug-in component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

# ----
# SNAPPYHEXMESH
snappyhexmesh = Butterfly_snappyHexMesh(case=blockmesh.case, glob_refine_level="2,2", write=Toggle(False), run=toggle_3)  # -> report, case; plug-in component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
# VISUALIZE MESH
loadmesh = Butterfly_LoadMesh(case=blockmesh.case, inner_mesh=False, load=Toggle(False))  # -> mesh; disabled; plug-in component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
solutionparams = Butterfly_SolutionParameters(control_dict=controldict, probes=probes)  # -> solution_par; plug-in component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
# step3.2 = 顯示風場中基本型的mesh
toggle_4 = BooleanToggle(True)
loadmesh_2 = Butterfly_LoadMesh(case=snappyhexmesh.case, inner_mesh=False, load=toggle_4)  # -> mesh; plug-in component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
# Solution should be converged in 561 iterations with default settings.
steadyincomp = Butterfly_SteadyIncompressibleRecipe()  # -> report, recipe; plug-in component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

# ----
# step5 = 計算風場
toggle_5 = BooleanToggle(False)

# ----
# SOLUTION
solution = Butterfly_Solution(
    case=snappyhexmesh.case,
    recipe=steadyincomp.recipe,
    solution_par=solutionparams,
    interval=2,
    write=Toggle(False),
    run=toggle_5)  # -> report, solution, is_running, timestep, residual_fields, residual_values, log_files; plug-in component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
# step6=顯示風場中的單位風向
loadprobesvalue = Butterfly_LoadProbesValue(solution=solution.solution, field="U")  # -> values; plug-in component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
panel_8 = Panel(solution.report)

# ----
# 取得
# 計算後的向量
# 套用到
# 設定區位的點位 上
pt_2 = Point(genpts.points)
vec_2 = Vector(loadprobesvalue)

panel_9 = Panel(solution.residual_values)
vlen = VectorLength(Vector=vec_2)
multiplication_2 = Multiplication(A=vec_2, B=Slider(7, range=0..100))

bnd = Bounds(Numbers=vlen)
sort = SortList(Keys=vlen)  # -> Keys, ValuesA
# 確保運算上 不要有太大的值
panel_10 = Panel(bnd)
panel_11 = Panel(sort.Keys)

dedomain = DeconstructDomain(Domain=panel_10)  # -> Start, End
gradient = Gradient(
    LowerLimit=dedomain.Start,
    UpperLimit="1",
    Parameter=vlen,
    stops=[0: RGB(220, 0, 40), 0.599: RGB(128, 255, 128), 1: RGB(128, 128, 255)])
vdisex = VectorDisplayEx(Point=pt_2, Vector=multiplication_2, Colour=gradient, Width=2)
