# Grasshopper definition ReadJSONFILE_content.gh (Grasshopper 1.0.7)

path = FilePath("E:\DN\MEGA\output_YY.json")
# p5jsInput II
python = GhPythonScript(input=path)  # -> out, readJSON
# ---------- python: Python ----------
__author__ = "chifu"
__version__ = "2022.12.06"


import rhinoscriptsyntax as rs
import json
from Grasshopper.Kernel.Data import GH_Path
from Grasshopper import DataTree
import System
from scriptcontext import sticky

readJSON = DataTree[System.Object]()

if (input):
    # JSON file to read
    file = open(input)
    # Load the data
    content = json.load(file)
    for i,obj in enumerate(content['data']):
        path = GH_Path(i)
#        if int(obj['st'])>0:
        readJSON.Add(float(obj['x']),path)
        readJSON.Add(float(obj['y']),path)
        if obj['st']==1:
            readJSON.Add(int(obj['sumState']),path)
        else:
            readJSON.Add(-1,path)
# ---------- end python ----------
# p5jsInput I
python_2 = GhPythonScript(input=path)  # -> out, readJSON
# ---------- python_2: Python ----------
__author__ = "chifu"
__version__ = "2022.12.06"


import rhinoscriptsyntax as rs
import json
from Grasshopper.Kernel.Data import GH_Path
from Grasshopper import DataTree
import System
from scriptcontext import sticky

readJSON = DataTree[System.Object]()

if (input):
    # JSON file to read
    file = open(input)
    # Load the data
    content = json.load(file)
    for i,obj in enumerate(content['data']):
        path = GH_Path(i)
        if int(obj['st'])>0:
            readJSON.Add(float(obj['pos']['x']),path)
            readJSON.Add(float(obj['pos']['y']),path)
            readJSON.Add(int(obj['sumState']),path)
# ---------- end python_2 ----------
geo = Geometry([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])
panel = Panel(python.readJSON)
panel_2 = Panel(python_2.readJSON)
item = ListItem(List=geo, Index=0, Wrap=True)  # -> Item, Item1, Item2, Item3

number_slider = Slider(25, range=0..50)
# Parameteric layout
number_slider_2 = Slider(100, range=0..100)
msphere = MeshSphere(Base=PlaneXY(0, 0, 0), Radius=number_slider_2, UCount=number_slider, VCount=number_slider)
ghpython_script = GhPythonScript(x=msphere)  # -> out, a, b, c; inputs x: Mesh
# ---------- ghpython_script: Python ----------
__author__ = "chifu"
__version__ = "2022.03.23"

import rhinoscriptsyntax as rs
import Rhino

c=[]
d=[]
for f in x.Faces:
    tm = Rhino.Geometry.Mesh();
    tm.Vertices.Add(x.Vertices[f.A])
    tm.Vertices.Add(x.Vertices[f.B])
    tm.Vertices.Add(x.Vertices[f.C])
    if f.IsTriangle:
        tm.Faces.AddFace(0, 1, 2)
    if f.IsQuad:
        tm.Vertices.Add(x.Vertices[f.D])
        tm.Faces.AddFace(0, 1, 2,3)
    tm.Normals.ComputeNormals()
    tm.Compact()
    c.append(tm)

a=x.Vertices
b=x.Faces
# ---------- end ghpython_script ----------
area = Area(Geometry=ghpython_script.c)  # -> Area, simplify(graft(Centroid))
facen = FaceNormals(Mesh=ghpython_script.c)  # -> Centers, simplify(Normals)
pl = PlaneNormal(Origin=area.Centroid, ZAxis=facen.Normals)

# ----
# Generanl grid
item_2 = ListItem(List=panel_2, Index=0, Wrap=True)  # -> Item, Item1, Item2
pt = ConstructPoint(XCoordinate=item_2.Item, YCoordinate=item_2.Item1, ZCoordinate=0)

item_3 = ListItem(List=panel, Index=0, Wrap=True)  # -> Item, Item1, Item2
p_n_c = PickNChoose(Pattern=item_2.Item2, Stream0=item.Item, Stream1=item.Item1, Stream2=item.Item2, Stream3=item.Item3)
p_n_c_2 = PickNChoose(Pattern=item_3.Item2, Stream0=item.Item, Stream1=item.Item1, Stream2=item.Item2, Stream3=item.Item3)
move = Move(Geometry=p_n_c, Motion=pt)  # -> Geometry, Transform
panel_3 = Panel(item_3.Item2)
orient = Orient(Geometry=p_n_c_2, Source=PlaneXY(0, 0, 0), Target=pl)  # -> Geometry, Transform
