# Grasshopper definition cross_reference_rule_sel.gh (Grasshopper 1.0.7)
# plug-ins: Bifocals

number_slider = Slider(8, range=0..10)  # disabled
number_slider_2 = Slider(8, range=0..10)  # disabled
number_slider_3 = Slider(8, range=0..10)  # disabled
geometry = Geometry([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])  # disabled
geometry_2 = Geometry([Point(-218.4217316, -794.4096914, 0), Point(-244.7638569, -840.0355908, 0), Point(-192.0796063, -840.0355908, 0), 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])  # disabled
point = Point([Point(-214.2003416, -417.0176204, 0), Point(-240.5424669, -462.6435199, 0), Point(-187.8582163, -462.6435199, 0)])  # disabled
geometry_3 = Geometry(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)  # disabled
curve = Curve([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])  # disabled
point_2 = Point([Point(-192.0796063, -840.0355908, 0), Point(-244.7638569, -840.0355908, 0), Point(-218.4217316, -794.4096914, 0)])  # disabled
geometry_4 = Geometry([Point(-218.4217316, -794.4096914, 0), Point(-244.7638569, -840.0355908, 0), Point(-192.0796063, -840.0355908, 0), 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])  # disabled
geometry_5 = Geometry(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)  # disabled
curve_2 = Curve([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])  # disabled
point_3 = Point([Point(-192.0796063, -840.0355908, 0), Point(-244.7638569, -840.0355908, 0), Point(-218.4217316, -794.4096914, 0)])  # disabled
geometry_6 = Geometry(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)  # disabled
curve_3 = Curve([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])  # disabled
boolean_toggle = BooleanToggle(True)  # disabled
# 另外設定的必選點
panel = Panel("""2
5""")
boolean_toggle_2 = BooleanToggle(True)  # disabled
boolean_toggle_3 = BooleanToggle(True)  # disabled
mesh_brep = MeshBrep(
    Brep=geometry,
    Settings={GridMaxCount=0, GridMinCount=16, JaggedSeams=False, MaxEdgeLength=0, MinEdgeLength=0.0001, MinTolerance=0, Refine=True, RefineAngle=0, RelativeTolerance=0.65, SimplePlanes=True, Tolerance=0})  # disabled
point_list = PointList(Points=point, Size=number_slider)  # disabled
point_list_2 = PointList(Points=point_2, Size=number_slider_2)  # disabled
point_list_3 = PointList(Points=point_3, Size=number_slider_3)  # disabled
panel_2 = Panel("DETAIL")  # disabled
panel_3 = Panel("DETAIL")  # disabled
panel_4 = Panel("DETAIL")  # disabled
attribute = Wasp_Attribute(ID=panel_2, VAL=mesh_brep, TR=boolean_toggle)  # -> ATTR; inputs VAL: list, TR: Boolean; disabled; plug-in component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
attribute_2 = Wasp_Attribute(ID=panel_3, VAL=geometry_2, TR=boolean_toggle_2)  # -> ATTR; inputs VAL: list, TR: Boolean; disabled; plug-in component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
attribute_3 = Wasp_Attribute(ID=panel_4, VAL=geometry_4, TR=boolean_toggle_3)  # -> ATTR; inputs VAL: list, TR: Boolean; disabled; plug-in component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
conndir = Wasp_ConnectionFromDirection(GEO=geometry_3, CEN=point, UP=curve)  # -> CONN, PLN_OUT; inputs CEN: list of Point3d, UP: list of Curve, T: list; disabled; plug-in component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
conndir_2 = Wasp_ConnectionFromDirection(GEO=geometry_5, CEN=point_2, UP=curve_2)  # -> CONN, PLN_OUT; inputs CEN: list of Point3d, UP: list of Curve, T: list; disabled; plug-in component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
conndir_3 = Wasp_ConnectionFromDirection(GEO=geometry_6, CEN=point_3, UP=curve_3)  # -> CONN, PLN_OUT; inputs CEN: list of Point3d, UP: list of Curve, T: list; disabled; plug-in component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
panel_5 = Panel("HEXA")  # disabled
panel_6 = Panel("HEXA")  # disabled
panel_7 = Panel("HEXA")  # disabled
part = Wasp_BasicPart(NAME=panel_5, GEO=geometry_3, CONN=flatten(conndir.CONN), ATTR=attribute)  # -> PART; inputs GEO: Mesh, CONN: list, ATTR: list; disabled; plug-in component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
part_2 = Wasp_BasicPart(NAME=panel_6, GEO=geometry_5, CONN=flatten(conndir_2.CONN), ATTR=attribute_2)  # -> PART; inputs GEO: Mesh, CONN: list, ATTR: list; disabled; plug-in component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
part_3 = Wasp_BasicPart(NAME=panel_7, GEO=geometry_6, CONN=flatten(conndir_3.CONN), ATTR=attribute_3)  # -> PART; inputs GEO: Mesh, CONN: list, ATTR: list; disabled; plug-in component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
unit_y = UnitY(Factor=Slider(-23, range=-100..100))
rulegen = Wasp_RulesGenerator()  # -> R; inputs PART: list, SELF_P: Boolean, SELF_C: Boolean, TYP: Boolean, GR: list; disabled; plug-in component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
rulegen_2 = Wasp_RulesGenerator(PART=part)  # -> R; inputs PART: list, SELF_P: Boolean, SELF_C: Boolean, TYP: Boolean, GR: list; disabled; plug-in component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
rulegen_3 = Wasp_RulesGenerator()  # -> R; inputs PART: list, SELF_P: Boolean, SELF_C: Boolean, TYP: Boolean, GR: list; disabled; plug-in component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
rulegen_4 = Wasp_RulesGenerator(PART=part_2)  # -> R; inputs PART: list, SELF_P: Boolean, SELF_C: Boolean, TYP: Boolean, GR: list; disabled; plug-in component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
rulegen_5 = Wasp_RulesGenerator()  # -> R; inputs PART: list, SELF_P: Boolean, SELF_C: Boolean, TYP: Boolean, GR: list; disabled; plug-in component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
rulegen_6 = Wasp_RulesGenerator(PART=part_3)  # -> R; inputs PART: list, SELF_P: Boolean, SELF_C: Boolean, TYP: Boolean, GR: list; disabled; plug-in component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
number_slider_4 = Slider(6, range=0..1000)  # disabled
number_slider_5 = Slider(6, range=0..1000)  # disabled
number_slider_6 = Slider(6, range=0..1000)  # disabled
button = Button()  # disabled
button_2 = Button()  # disabled
button_3 = Button()  # disabled
stochasticaggregation = Wasp_StochasticAggregation(PART=flatten(part), N=number_slider_4, RULES=rulegen_2, RESET=button)  # -> AGGR, PART_OUT; inputs PART: list, PREV: list, N: Int32, RULES: list, SEED: Int32, MODE: Int32, GC: list, RESET: Boolean; disabled; plug-in component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
stochasticaggregation_2 = Wasp_StochasticAggregation(PART=flatten(part_2), N=number_slider_5, RULES=rulegen_4, RESET=button_2)  # -> AGGR, PART_OUT; inputs PART: list, PREV: list, N: Int32, RULES: list, SEED: Int32, MODE: Int32, GC: list, RESET: Boolean; disabled; plug-in component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
stochasticaggregation_3 = Wasp_StochasticAggregation(PART=flatten(part_3), N=number_slider_6, RULES=rulegen_6, RESET=button_3)  # -> AGGR, PART_OUT; inputs PART: list, PREV: list, N: Int32, RULES: list, SEED: Int32, MODE: Int32, GC: list, RESET: Boolean; disabled; plug-in component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
vec = VectorXYZ(XComponent=Slider(0, range=0..100), YComponent=Slider(59, range=-100..100), ZComponent=0)  # -> Vector, Length
panel_8 = Panel("HEXA")  # disabled
panel_9 = Panel("HEXA")  # disabled
panel_10 = Panel("HEXA")  # disabled
namefilter = Wasp_FilterPartsByName(PART=stochasticaggregation.PART_OUT, NAME=panel_8)  # -> PART_OUT, MASK; inputs PART: list, NAME: list; disabled; plug-in component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
namefilter_2 = Wasp_FilterPartsByName(PART=stochasticaggregation_2.PART_OUT, NAME=panel_9)  # -> PART_OUT, MASK; inputs PART: list, NAME: list; disabled; plug-in component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
namefilter_3 = Wasp_FilterPartsByName(PART=stochasticaggregation_3.PART_OUT, NAME=panel_10)  # -> PART_OUT, MASK; inputs PART: list, NAME: list; disabled; plug-in component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
point_4 = Point([Point(-9.720671808, -0.5055704809, 0), Point(16.6214535, 1.643902253, 19.10740356), Point(16.6214535, 1.643902253, 0), Point(-9.720671808, -43.98199716, 0), Point(-9.720671808, -13.56473088, 19.10740356), Point(-9.720671808, 16.85253539, 19.10740356)])
line = Line([Line((16.6214535, 1.643902253, 19.10740356), (-9.720671808, -13.56473088, 19.10740356)), Line((-9.720671808, -13.56473088, 19.10740356), (-9.720671808, 16.85253539, 19.10740356)), Line((-9.720671808, 16.85253539, 19.10740356), (16.6214535, 1.643902253, 19.10740356)), Line((-9.720671808, -0.5055704809, 0), (16.6214535, 1.643902253, 0)), Line((16.6214535, 1.643902253, 0), (-9.720671808, -43.98199716, 0)), Line((-9.720671808, -43.98199716, 0), (-9.720671808, -0.5055704809, 0))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])
value_list = ValueList({"BASE GEO": 0, "DETAILED GEO": 1}, selected="DETAILED GEO")  # disabled
value_list_2 = ValueList({"BASE GEO": 0, "DETAILED GEO": 1}, selected="DETAILED GEO")  # disabled
value_list_3 = ValueList({"BASE GEO": 0, "DETAILED GEO": 1}, selected="DETAILED GEO")  # disabled
panel_11 = Panel("DETAIL")  # disabled
panel_12 = Panel("DETAIL")  # disabled
panel_13 = Panel("DETAIL")  # disabled
partgeo = Wasp_GetPartGeometry(PART=namefilter.PART_OUT)  # -> GEO; disabled; plug-in component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
getattr = Wasp_GetAttributeByName(PART=namefilter.PART_OUT, ID=panel_11)  # -> VAL; disabled; plug-in component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
partgeo_2 = Wasp_GetPartGeometry(PART=namefilter_2.PART_OUT)  # -> GEO; disabled; plug-in component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
getattr_2 = Wasp_GetAttributeByName(PART=namefilter_2.PART_OUT, ID=panel_12)  # -> VAL; disabled; plug-in component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
partgeo_3 = Wasp_GetPartGeometry(PART=namefilter_3.PART_OUT)  # -> GEO; disabled; plug-in component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
getattr_3 = Wasp_GetAttributeByName(PART=namefilter_3.PART_OUT, ID=panel_13)  # -> VAL; disabled; plug-in component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
points = PointList(Size=Slider(10, range=0..10))
stream_filter = StreamFilter(Gate=value_list, Stream0=partgeo, Stream1=getattr)  # disabled
stream_filter_2 = StreamFilter(Gate=value_list_2, Stream0=partgeo_2, Stream1=getattr_2)  # disabled
stream_filter_3 = StreamFilter(Gate=value_list_3, Stream0=partgeo_3, Stream1=getattr_3)  # disabled
colour_swatch = ColourSwatch(SwatchColor=RGB(191, 182, 182))  # disabled
colour_swatch_2 = ColourSwatch(SwatchColor=RGB(191, 182, 182))  # disabled
colour_swatch_3 = ColourSwatch(SwatchColor=RGB(191, 182, 182))  # disabled
custom_preview = CustomPreview(Geometry=stream_filter, Material=colour_swatch)  # disabled
custom_preview_2 = CustomPreview(Geometry=stream_filter_2, Material=colour_swatch_2)  # disabled
custom_preview_3 = CustomPreview(Geometry=stream_filter_3, Material=colour_swatch_3)  # disabled

geo = Geometry(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)  # disabled

# ----
# 6points(line+nurbs curve)
point_5 = Point([Point(-9.720671808, -0.5055704809, 0), Point(16.6214535, 1.643902253, 19.10740356), Point(16.6214535, 1.643902253, 0), Point(-9.720671808, -43.98199716, 0), Point(-9.720671808, -13.56473088, 19.10740356), Point(-9.720671808, 16.85253539, 19.10740356)])
points_2 = PointList(Points=point_5, Size=Slider(10, range=0..10))
list_length = ListLength(List=point_5)
series = Series(Start=0, Step=1, Count=list_length)
cross_reference = CrossReference(ListListA=panel, ListListB=panel, ListC=series, ListD=series, ListE=series, CrossMode=3)  # -> ListListA, ListListB, ListC, ListD, ListE
list_item = ListItem(List=point_5, Index=cross_reference.ListC, Wrap=True)
list_item_2 = ListItem(List=point_5, Index=cross_reference.ListD, Wrap=True)
list_item_3 = ListItem(List=point_5, Index=cross_reference.ListE, Wrap=True)
merge = Merge(Data1=graft(list_item), Data2=graft(list_item_2), Data3=graft(list_item_3))  # -> simplify(Result)
number_slider_7 = Slider(719, range=0..719)
nurbs_curve = NurbsCurve(Vertices=merge, Degree=3, Periodic=False)  # -> flatten(Curve), Length, Domain
list_item_4 = ListItem(List=nurbs_curve.Curve, Index=number_slider_7, Wrap=True)

list_length_2 = ListLength(List=cross_reference.ListE)

list_item_5 = ListItem(List=point_5, Index=cross_reference.ListListB, Wrap=True)
# 另外設定的線段
# 另外設定的線段
list_item_6 = ListItem(List=point_5, Index=cross_reference.ListListA, Wrap=True)

series_2 = Series(Start=0, Step=1, Count=list_length_2)  # -> simplify(graft(Series))
square_root = SquareRoot(Value=list_length_2)

line_2 = Line(StartPoint=list_item_6, EndPoint=list_item_5)
list_item_7 = ListItem(List=line_2, Index=number_slider_7, Wrap=True)
merge_2 = Merge(Data1=list_item_7, Data2=list_item_4)  # -> flatten(Result)
loft = Loft(Curves=merge_2, Options={Adjust=False, Closed=False, LoftEnds=0, LoftSimp=0, LoftType=0, Rebuild=10, Refit=0.01})

square = Square(Plane=PlaneXY(0, 0, 0), Size=Slider(100, range=0..100), ExtentX=square_root, ExtentY=square_root)  # -> flatten(Cells), Points
move = Move(Geometry=square.Cells, Motion=unit_y)  # -> Geometry, Transform
list_item_8 = ListItem(List=line_2, Index=series_2, Wrap=True)
list_item_9 = ListItem(List=nurbs_curve.Curve, Index=series_2, Wrap=True)
area = Area(Geometry=square.Cells)  # -> Area, simplify(graft(Centroid))
merge_3 = Merge(Data1=list_item_8, Data2=list_item_9)
loft_2 = Loft(Curves=merge_3, Options={Adjust=False, Closed=False, LoftEnds=0, LoftSimp=0, LoftType=0, Rebuild=10, Refit=0.01})
subtraction = Subtraction(A=area.Centroid, B=vec.Vector)
move_2 = Move(Geometry=point_4, Motion=area.Centroid)  # -> Geometry, Transform
move_3 = Move(Geometry=line, Motion=area.Centroid)  # -> Geometry, Transform
move_4 = Move(
    Geometry=Tree({0}: [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], {1}: [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], {2}: [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], {3}: [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], {4}: [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], {5}: [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]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),
    Motion=area.Centroid)  # -> Geometry, Transform

# ----
# 製作陰影面積資訊
mesh = MeshBrep(
    Brep=move_4.Geometry,
    Settings={GridMaxCount=0, GridMinCount=16, JaggedSeams=False, MaxEdgeLength=0, MinEdgeLength=0.0001, MinTolerance=0, Refine=True, RefineAngle=0, RelativeTolerance=0.65, SimplePlanes=True, Tolerance=0})  # disabled
mshadow = MeshShadow(Mesh=mesh, Light=Vector(0, 0, -1), Plane=PlaneXY(0, 0, 0))  # disabled
area_2 = Area(Geometry=mshadow)  # -> Area, Centroid; disabled

number_slider_8 = Slider(300, range=0..1000)  # disabled
number_slider_9 = Slider(556, range=0..1000)  # disabled
# 選擇條件
larger = LargerThan(FirstNumber=area_2.Area, SecondNumber=number_slider_8)  # -> LargerThan, OrEqualTo; disabled
smaller = SmallerThan(FirstNumber=area_2.Area, SecondNumber=number_slider_9)  # -> SmallerThan, OrEqualTo; disabled
and = GateAnd(A=larger.LargerThan, B=smaller.SmallerThan)  # -> simplify(Result); disabled
dispatch = Dispatch(List=area.Centroid, DispatchPattern=and)  # -> simplify(ListA), ListB; disabled

tag = TextTag(Location=area.Centroid, Text=area_2.Area)  # disabled

number_slider_10 = Slider(563, range=0..1000)  # disabled
# 選擇條件
larger_2 = LargerThan(FirstNumber=area_2.Area, SecondNumber=number_slider_10)  # -> LargerThan, OrEqualTo; disabled
dispatch_2 = Dispatch(List=area.Centroid, DispatchPattern=larger_2.LargerThan)  # -> simplify(ListA), ListB; disabled

move_5 = Move(Geometry=geo, Motion=dispatch.ListA)  # -> Geometry, Transform; disabled
swatch = ColourSwatch(SwatchColor=RGB(255, 0, 169))  # disabled
preview = CustomPreview(Geometry=move_5.Geometry, Material=swatch)  # disabled

move_6 = Move(Geometry=geo, Motion=dispatch_2.ListA)  # -> Geometry, Transform; disabled
swatch_2 = ColourSwatch(SwatchColor=RGB(31, 40, 255))  # disabled
preview_2 = CustomPreview(Geometry=move_6.Geometry, Material=swatch_2)  # disabled
