# Grasshopper definition direct_sun_study.gh (Grasshopper 1.0.7)
# plug-ins: Bifocals

# ----
# Import Location from EPW File
panel = Panel("http://climate.onebuilding.org/WMO_Region_4_North_and_Central_America/USA_United_States_of_America/WI_Wisconsin/USA_WI_Madison-Dane.County.Rgnl.AP-Truax.Field.726410_TMY3.zip")
downloadepw = LBDownloadWeather(weather_URL=panel)  # -> epw_file, stat_file, ddy_file; plug-in component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

# ----
# 一段時間的太陽照射角度
panel_2 = Panel("6")
analysisperiod = LBAnalysisPeriod(start_month=panel_2, start_day="21", start_hour=0, end_month=panel_2, end_day="21", timestep="4")  # -> period, hoys, dates; plug-in component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

# ----
# 直接使用已下載的epw
path = FilePath("E:\[WORKING]\00=課程\2022_08=02=1111淡江EA4\climate\TWN_Taipei.466960_IWEC.epw")

# ----
# 特別時間的太陽照射角度
hoy = LBCalculateHOY()  # -> flatten(hoy), flatten(doy), flatten(date); plug-in component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

importloc = LBImportLocation(epw_file=path)  # -> location; plug-in component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
pipeline = GeometryPipeline(
    GroupByLayer=False,
    GroupByType=False,
    IncludeHidden=True,
    IncludeLocked=True,
    LayerFilter="Default",
    NameFilter="*",
    SublayerFiltering=True,
    TypeFilter=1073741848)

# ----
# 太陽路徑
sunpath = LBSunPath(location=importloc, hoys=analysisperiod.hoys, scale=1)  # -> report, vectors, altitudes, azimuths, hoys, sun_pts, analemma, daily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; plug-in component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

panel_3 = Panel(pipeline)
geo = Geometry(pipeline)
# 測試單元
geo_2 = Geometry([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])
number_slider = Slider(-143, range=-180..180)

bbox = BoundingBox(Content=geo_2, Plane=PlaneXY(0, 0, 0), UnionBox=True)  # -> Box, Box_2
area = Area(Geometry=bbox.Box)  # -> Area, Centroid
rotate = Rotate(Geometry=geo_2, Angle=degrees(number_slider), Plane=area.Centroid)  # -> Geometry, Transform

# ----
# 涵構
# 格點大小
toggle = BooleanToggle(True)
# step1：直接使用 Default layer的物件
geo_3 = Geometry(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)
directsunhours = LBDirectSunHours(
    vectors=flatten(sunpath.vectors),
    timestep="4",
    geometry=flatten(geo),
    context=flatten(geo_3),
    grid_size="35",
    offset_dist="1",
    run=toggle)  # -> report, points, results, mesh, legend, title, int_mtx; plug-in component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

# ----
# step2 ：判斷最佳(耗能最低) 方向
directsunhours_2 = LBDirectSunHours(
    vectors=flatten(sunpath.vectors),
    timestep="4",
    geometry=flatten(rotate.Geometry),
    context=flatten(geo_3),
    grid_size="35",
    offset_dist="1",
    run=Toggle(True))  # -> report, points, results, mesh, legend, title, int_mtx; plug-in component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
panel_4 = Panel(directsunhours_2.results)
ma = MassAddition(Input=panel_4)  # -> Result, PartialResults
panel_5 = Panel(ma.Result)

panel_6 = Panel(directsunhours.results)
galapagos = Galapagos(fitness=ma, gene=number_slider)
